# Grasshopper definition notion-demo-template.gh (Grasshopper 1.0.8)

# ---- group: Any script can go here.
width = Slider(1000, range=0..10000)
depth = Slider(5000, range=0..10000)
# STEP 1
# Create (free) account and go to go to https://www.notion.so/my-integrations. Create a token with default permissions.
# 
# STEP 2
# Create an empty page in a designated workspace. This is the scope of the API.
# On the same page as step 1, make sure to give access to this page under "Content Access".
# 
# STEP 3
# Insert token here. (Note: sensitive keys should actually be stored as an environment variable for security. But for a demo this is fine.)
# 
# STEP 4
# Set a directory path for temporary images. May be deleted after.
# 
# STEP 5
# Organize the input- or output parameters you wish to include in key value-pairs.
# 
# STEP 6
# Set page parent_id
# 
# STEP 7
# Instantiate database
# 
# STEP 8
# Your setup is ready! You can send start sending stuff to your own Notion explorer! :-)
height = Slider(5000, range=0..10000)
# Notion Parametric Explorer Demo
# by Marijn Luijmes
# www.ontologic.tech
swatch = ColourSwatch(SwatchColor=RGB(255, 84, 84))
box = CenterBox(Base=PlaneXY(0, 0, 0), X=width, Y=width, Z=width)
volume = Volume(Geometry=box)  # -> expr("x/1000000000", Volume), Centroid
area = Area(Geometry=box)  # -> expr("x/1000000", Area), Centroid
preview = CustomPreview(Geometry=box, Material=swatch)
merge = Merge(Data1=width, Data2=depth, Data3=height, Data4=volume.Volume, Data5=area.Area)

# ----
panel = Panel("""width_mm
depth_mm
height_mm
volume_m3
area_m2""")

# ---- group: Something to trigger a compute
lng = ListLength(List=flatten(box))
null = NullItem(Item=lng)  # -> NullFlags, InvalidFlags, Description

# ----
send_to_notion = BooleanToggle(False)

# ---- group: Step 5
py3 = Python3Script(keys=panel, values=merge)  # -> json_out; inputs keys: list, values: list
# ---------- py3: Python ----------
import json

# Ensure both inputs are lists
if not isinstance(keys, list):
    keys = [keys]

if not isinstance(values, list):
    values = [values]

# Match shortest length to avoid index errors
count = min(len(keys), len(values))

data = {}

for i in range(count):
    data[str(keys[i])] = values[i]

# Convert to formatted JSON string
json_out = json.dumps(data, indent=4)
# ---------- end py3 ----------

# ----
and = GateAnd(A=send_to_notion, B=invert(null.NullFlags))
filter = StreamFilter(Gate=and, Stream1=py3)
null_2 = NullItem(Item=filter)  # -> NullFlags, InvalidFlags, Description

# ---- group: Step 4
path = FilePath("C:\Users\mglui\Desktop\study\")

# ----
bool = Boolean(invert(null_2.NullFlags))

# ---- group: Create image
py3_2 = Python3Script(directory=path, capture=bool)  # -> image_path
# ---------- py3_2: Python ----------
import Rhino
import System
import os
import datetime
import traceback
import scriptcontext as sc

debug_messages = []

file_prefix = ""
width = 800
height = 640

def log(msg):
    debug_messages.append(str(msg))

def safe_int(v, default):
    try:
        if v is None:
            return default
        return int(v)
    except:
        return default

def safe_str(v, default):
    try:
        s = "" if v is None else str(v)
        s = s.strip()
        return s if s else default
    except:
        return default


def capture_viewport_to_path(directory, width=800, height=600, file_prefix="option_capture"):
    log("capture_viewport_to_path called")

    if not directory:
        raise Exception("directory not provided")

    directory = os.path.expandvars(directory)
    directory = os.path.normpath(directory)

    if not os.path.exists(directory):
        os.makedirs(directory)

    doc = Rhino.RhinoDoc.ActiveDoc
    view = doc.Views.ActiveView

    if not view:
        raise Exception("no active view")

    # Force Rendered mode
    previous_mode = view.ActiveViewport.DisplayMode
    rendered_mode = Rhino.Display.DisplayModeDescription.FindByName("Rendered")

    if rendered_mode:
        view.ActiveViewport.DisplayMode = rendered_mode
        sc.doc.Views.Redraw()
        System.Threading.Thread.Sleep(100)
        sc.doc.Views.Redraw()

    timestamp = datetime.datetime.now().strftime("%Y%m%d_%H%M%S_%f")
    file_name = f"{file_prefix}_{timestamp}.png"
    file_path = os.path.join(directory, file_name)

    vc = Rhino.Display.ViewCapture()
    vc.Width = width
    vc.Height = height
    vc.ScaleScreenItems = False
    vc.DrawGrid = False
    vc.DrawAxes = False
    vc.DrawGridAxes = False
    vc.TransparentBackground = True

    bitmap = vc.CaptureToBitmap(view)

    # Restore mode
    view.ActiveViewport.DisplayMode = previous_mode
    sc.doc.Views.Redraw()

    if bitmap is None:
        raise Exception("CaptureToBitmap returned None")

    bitmap.Save(file_path, System.Drawing.Imaging.ImageFormat.Png)

    return file_path


# MAIN

try:
    if capture:
        image_path = capture_viewport_to_path(
            directory=safe_str(directory, ""),
            width=safe_int(width, 800),
            height=safe_int(height, 600),
            file_prefix=safe_str(file_prefix, "option_capture")
        )
        status = "capture_success"
    else:
        image_path = None
        status = "idle"

except Exception as e:
    status = "capture_error"
    image_path = None
    log(str(e))
    log(traceback.format_exc())

debug_log = "\n".join(debug_messages)
# ---------- end py3_2 ----------

# ---- group: Step 3 - Place notion token
panel_2 = Panel("<YOUR NOTION TOKEN HERE>")

# ---- group: Upload image to Notion
py3_3 = Python3Script(image_path=py3_2, notion_token=panel_2, upload=send_to_notion)  # -> file_upload_id
# ---------- py3_3: Python ----------
import json
import urllib.request
import urllib.error
import os
import uuid

notion_version = "2022-06-28"

debug = []

def log(msg):
    debug.append(str(msg))


def notion_json_request(url, payload, notion_token):
    data = json.dumps(payload).encode("utf-8")

    log("POST → " + url)
    log("payload → " + json.dumps(payload))

    req = urllib.request.Request(url, data=data)
    req.add_header("Authorization", f"Bearer {notion_token}")
    req.add_header("Content-Type", "application/json")
    req.add_header("Notion-Version", notion_version)

    with urllib.request.urlopen(req) as resp:
        body = resp.read().decode("utf-8")
        log("response →")
        log(body)
        return json.loads(body)


if upload:

    try:
        log("=== STEP 1: create file upload session ===")

        if not os.path.exists(image_path):
            raise Exception("image_path does not exist")

        session_payload = {
            "filename": os.path.basename(image_path)
        }

        session = notion_json_request(
            "https://api.notion.com/v1/file_uploads",
            session_payload,
            notion_token
        )

        upload_url = session["upload_url"]
        file_upload_id = session["id"]
        original_content_type = session["content_type"]

        log("upload_url → " + upload_url)
        log("file_upload_id → " + file_upload_id)
        log("expected_content_type → " + original_content_type)

        log("=== STEP 2: upload binary file (multipart/form-data) ===")

        with open(image_path, "rb") as f:
            file_bytes = f.read()

        log("file size (bytes) → " + str(len(file_bytes)))

        boundary = uuid.uuid4().hex
        delimiter = f"--{boundary}"
        close_delim = f"--{boundary}--"

        multipart_body = (
            delimiter + "\r\n" +
            f'Content-Disposition: form-data; name="file"; filename="{os.path.basename(image_path)}"\r\n' +
            f"Content-Type: {original_content_type}\r\n\r\n"
        ).encode("utf-8") + file_bytes + b"\r\n" + close_delim.encode("utf-8") + b"\r\n"

        upload_req = urllib.request.Request(upload_url, data=multipart_body)
        upload_req.get_method = lambda: "POST"

        upload_req.add_header("Authorization", f"Bearer {notion_token}")
        upload_req.add_header("Notion-Version", notion_version)
        upload_req.add_header("Content-Type", f"multipart/form-data; boundary={boundary}")
        upload_req.add_header("Content-Length", str(len(multipart_body)))

        with urllib.request.urlopen(upload_req) as resp:
            response_body = resp.read().decode("utf-8")
            log("upload response →")
            log(response_body)

        log("=== SUCCESS ===")
        status = "upload_success"

    except urllib.error.HTTPError as e:
        error_body = e.read().decode("utf-8")
        file_upload_id = None
        status = "upload_error"
        log("upload http_error →")
        log(error_body)

    except Exception as e:
        file_upload_id = None
        status = "upload_error"
        log("final_exception →")
        log(str(e))

else:
    file_upload_id = None
    status = "idle"
    log("idle")


debug_log = "\n".join(debug)
# ---------- end py3_3 ----------

# ---- group: Step 6
create_database = Button()

# ---- group: Send data
py3_4 = Python3Script(
    notion_token=panel_2,
    parent_page_id="<YOUR PAGE ID HERE>",
    create_db=create_database,
    database_name="Parametric Explorer",
    image_upload_id=py3_3,
    option_data=filter,
    send=send_to_notion)  # -> status
# ---------- py3_4: Python ----------
import json
import datetime
import urllib.request
import urllib.error
import scriptcontext as sc

notion_version = "2022-06-28"

debug_messages = []

def log(msg):
    debug_messages.append(str(msg))

def iso_now():
    return datetime.datetime.utcnow().replace(microsecond=0).isoformat() + "Z"

def notion_request(url, payload, notion_token):
    try:
        data = json.dumps(payload).encode("utf-8")

        log("POST → " + url)
        log("payload → " + json.dumps(payload)[:500])

        req = urllib.request.Request(url, data=data)
        req.add_header("Authorization", f"Bearer {notion_token}")
        req.add_header("Content-Type", "application/json")
        req.add_header("Notion-Version", notion_version)

        with urllib.request.urlopen(req) as resp:
            body = resp.read().decode("utf-8")
            log("response → " + body[:500])
            return True, json.loads(body)

    except urllib.error.HTTPError as e:
        error_body = e.read().decode("utf-8")
        log("http_error → " + error_body)
        return False, error_body

    except Exception as e:
        log("general_exception → " + str(e))
        return False, str(e)


# ---------------------------------------
# create database
# ---------------------------------------

if create_db:

    log("create_db triggered")

    # Basic structure
    properties = {
        "name": {"title": {}},
        "created": {"date": {}}
    }

    # If option_data provided, infer property types
    if option_data:
        if isinstance(option_data, str):
            option_dict = json.loads(option_data)
        else:
            option_dict = option_data

        for key, value in option_dict.items():
            if key == "name":
                continue
            if isinstance(value, (int, float)):
                properties[key] = {"number": {}}
            else:
                properties[key] = {"rich_text": {}}

    # If image support needed
    properties["preview_image"] = {"files": {}}

    payload = {
        "parent": {
            "type": "page_id",
            "page_id": parent_page_id
        },
        "title": [
            {
                "type": "text",
                "text": {"content": database_name or "parametric_study"}
            }
        ],
        "properties": properties
    }

    ok, result = notion_request(
        "https://api.notion.com/v1/databases",
        payload,
        notion_token
    )

    if ok:
        db_id = result["id"]
        sc.sticky["notion_db_id"] = db_id
        status = "database_created"
        database_id = db_id
        log("database created")
    else:
        status = "db_error"
        database_id = None


# ---------------------------------------
# send option row
# ---------------------------------------

elif send:

    log("send triggered")

    db_id = sc.sticky.get("notion_db_id", None)

    if not db_id:
        status = "no_database_created"
        database_id = None

    else:
        try:
            if isinstance(option_data, str):
                option_dict = json.loads(option_data)
            else:
                option_dict = option_data or {}

            properties_payload = {}

            for key, value in option_dict.items():

                if key == "name":
                    properties_payload["name"] = {
                        "title": [{"text": {"content": str(value)}}]
                    }

                elif isinstance(value, (int, float)):
                    properties_payload[key] = {"number": float(value)}

                else:
                    properties_payload[key] = {
                        "rich_text": [{"text": {"content": str(value)}}]
                    }

            # Always add created timestamp
            properties_payload["created"] = {
                "date": {"start": iso_now()}
            }

            # Attach image if available
            if image_upload_id:
                properties_payload["preview_image"] = {
                    "files": [
                        {
                            "type": "file_upload",
                            "file_upload": {
                                "id": image_upload_id
                            }
                        }
                    ]
                }

            payload = {
                "parent": {"database_id": db_id},
                "properties": properties_payload
            }

            ok, result = notion_request(
                "https://api.notion.com/v1/pages",
                payload,
                notion_token
            )

            if ok:
                status = "option_sent"
                log("row created")
            else:
                status = "row_error"
                log(result)

            database_id = db_id

        except Exception as e:
            status = "payload_error"
            database_id = db_id
            log(str(e))


else:
    status = "idle"
    database_id = sc.sticky.get("notion_db_id", None)


debug_log = "\n".join(debug_messages)
# ---------- end py3_4 ----------

# ----
panel_3 = Panel(py3_4)
